vi "testrecord.gvi"   [LabVIEW Communications System Design Software 2.0.1]
panel controls:
  "loop count": i32
panel indicators:
  "size(s)": i32
  "Array": string[]
  "Graph": waveform<f64>[]
  "indices": i32[]
  "count": i32
  "power spectrum": T1
  "Graph_2": T1
types:
  T1 = cluster{"f0": f64, "df": f64, "magnitude": f64[]}
uses:
  NI::Analysis::Generation::Square Waveform.gvi
  NI::Analysis::Generation::Sine Waveform.gvi
  NI::Analysis::Measurement::Power Spectrum for 1 Chan.gvi
  NI::Analysis::Measurement::Cross Power (DBL).gvi
  NI::Analysis::Measurement::Threshold Detector.gvi
diagram:
  call "Square Waveform.gvi"() -> (square wave=w1)
  call "Sine Waveform.gvi"(amplitude=1, frequency=10, sample rate=1024, samples=1024) -> (sine wave=w2)
  Build Array(w1, w2) -> w3
  $Graph <- w3
  w4 = $"loop count"
  Get Component Directory() -> (Path=w5)
  # cwd
  Build Path(base path=w5, name or relative path=path "test_data.tdms") -> (appended path=w6)
  TDMS Open(file path=w6, operation="create or replace") -> (error out=w7, tdms file out=w8)
  for (N = w4) (iteration -> i1) {
    Build Array(w1, w2) -> w9
    Format Into String(initString="Group", i1) -> w10
    Array Size(array=w9) -> (size(s)=w11)
    for (N = w11) (iteration -> i2) {
      Format Into String(initString="Channel", i2) -> w13
      append w13 to w12
    }
    TDMS Write(channel name(s) in=w12, data=w9, error in=w7, group name in=w10, tdms file=w8) -> (error out=w14, tdms file out=w15)
    $"size(s)" <- w11
    # I read this is the best way
    # to initialize arrays.
    $Array <- w12
  }
  TDMS Close(error in=w14, tdms file=w15) -> (error out=w16)
  call "Display Error.gvi"(error in=w16)
  call "Power Spectrum for 1 Chan.gvi"(signal=w2, dB on=TRUE) -> (power spectrum=w17)
  $"power spectrum" <- w17
  Build Array[ConcatenateInputs=True](w17)
  $Graph_2 <- w17
  call "Cross Power (DBL).gvi"(signal x=w2, signal y=w2)
  Property Node(instance in=w17) -> ("magnitude"=w18)
  call "Threshold Detector.gvi"(signal=w18, threshold=-3.1, width=1) -> (indices=w19, count=w20)
  $indices <- w19
  $count <- w20
