vi "Aggregate Sub-band into Spectrum.gvi"   [LabVIEW Communications System Design Software 2.0.1]
inputs:
  "Frame Parameters": T1
  "Power Spectrum Subset": T2
  "Window Properties In": T3
  "Display": T5 = {"display unit"="Vrms", "dB type"="dB"}
  "Reset": bool
  "Iteration": i32
outputs:
  "Spectrum to Plot": cluster{"f0": f64, "df": f64, "IQ": f64[]}
  "Frame Parameters Out": T1
  "Spectrum Size": i32
panel controls:
  "Initialize Spectrum": cluster{"f0": f64, "df": f64, "IQ": f64[]}
types:
  T1 = cluster{"IQ Rate": f64, "Frames": i32, "Length of Subset": i32, "Start Carrier [Hz": f64, "Stop Carrier [Hz]": f64, "Acq Duration [Sec]": f64, "Start Index of Subset": i32}
  T2 = cluster{"f0": f64, "df": f64, "magnitude": f64[]}
  T3 = cluster{"eq noise bw": f64, "coherent gain": f64}
  T4 = enum{"Vrms", "Vpk", "Vrms^2", "Vpk^2", "Vrms/rtHz", "Vpk/rtHz", "Vrms^2/Hz", "Vpk^2/Hz"}
  T5 = cluster{"display unit": T4, "dB type": enum{"Linear", "dB", "dBm"}}
diagram:
  Property Node(instance in=$"Frame Parameters") -> ("Frames"=w1, "Length of Subset"=w2, "Start Index of Subset"=w3, instance out=w4)
  Multiply(w1, w2) -> w5
  call "Convert Power Spectrum.gvi"(Display=$Display, window constants=$"Window Properties In", Power Spectrum=$"Power Spectrum Subset") -> (Power Spectrum (converted)=w6)
  Property Node(instance in=w6) -> ("df"=w7, "magnitude"=w8)
  # Reset is unused
  Is First Call() -> w9
  Logical Or(w9, $Reset) -> w10
  Feedback Node(input=w11) -> w12
  case (w10) {
    frame False, Default {
      w13 = w12
    }
    frame True {
      Initialize Array(element=0, size=w5) -> w14
      # Initialize Spectrum History
      Property Node(instance in=$"Initialize Spectrum", "df"=w7, "IQ"=w14) -> (instance out=w13)
    }
  }
  # Remove Edges of
  # Sub Spectrum
  Array Subset(array=w8, index0=w3, length0=w2) -> w15
  Multiply($Iteration, w2) -> w16
  in-place (after w13) {
    Unbundle Bundle Read Poser() -> ("IQ"=w17)
    # Add Current Spectrum to Spectrum History
    Replace Array Subset(inArray=w17, index=w16, new=w15) -> w18
    Unbundle Bundle Write Poser("IQ"=w18)
    w11 = _
  }
  $"Spectrum to Plot" <- w11
  # w2: Length of Subset
  # w3: Start Index
  $"Frame Parameters Out" <- w4
  Property Node(instance in=w11) -> ("IQ"=w19)
  Array Size(array=w19) -> (size(s)=w20)
  $"Spectrum Size" <- w20
