vi "Establish Sub-band.gvi"   [LabVIEW Communications System Design Software 2.0.1]
inputs:
  "Restart Averaging": bool
  "Frame Parameters": T1
  "Averaging Parameters": "Averaging Parameters.gtype" = {"averaging mode"="No averaging", "weighting mode"="Exponential", "number of averages"=10}  # averaging parameters defines how the averaging is computed. The specifications of the parameters include the type of averaging, the type of weighting, and the number of averages.
  "error in": error
  "Input Baseband IQ": c128[]
  "Window Parameters": T2 = {"window type"=0, "window parameter"=NaN}
outputs:
  "Power Spectrum Subset": T5
  "Window Properties": T3
  "error out": error
  "Frame Parameters Out": T1
panel controls:
  "Window Properties Init": T3
types:
  T1 = cluster{"IQ Rate": f64, "Frames": i32, "Length of Subset": i32, "Start Carrier [Hz": f64, "Stop Carrier [Hz]": f64, "Acq Duration [Sec]": f64, "Start Index of Subset": i32}
  "windowTd.gtype" = u32
  T2 = cluster{"window type": "windowTd.gtype", "window parameter": f64}
  T3 = cluster{"eq noise bw": f64, "coherent gain": f64}
  T4 = enum{"No averaging", "Vector averaging", "RMS averaging", "Peak hold"}
  "Averaging Parameters.gtype" = cluster{"averaging mode": T4, "weighting mode": enum{"Linear", "Exponential"}, "number of averages": u32}
  T5 = cluster{"f0": f64, "df": f64, "magnitude": f64[]}
uses:
  NI::Analysis::Measurement::Power Spectrum for 1 Chan (CDB).gvi
  NI::Analysis::Windows::Window Properties by Name.gvi
diagram:
  Property Node(instance in=$"Frame Parameters") -> ("IQ Rate"=w1, instance out=w2)
  $"Frame Parameters Out" <- w2
  Property Node(instance in=$"Window Parameters") -> ("window type"=w3, "window parameter"=w4)
  Reciprocal(x=w1) -> w5
  Build Waveform Node(Y=$"Input Baseband IQ", dt=w5) -> (output waveform=w6)
  call "Power Spectrum for 1 Chan (CDB).gvi"(signal=w6, window type=w3, averaging parameters=$"Averaging Parameters", error in=$"error in", restart averaging=$"Restart Averaging", window parameter=w4) -> (power spectrum=w7, error out=w8)
  $"Power Spectrum Subset" <- w7
  $"error out" <- w8
  Array Size(array=$"Input Baseband IQ") -> (size(s)=w9)
  call "Window Properties by Name.gvi"(size=w9, window type=w3, window parameter=w4) -> (eq noise bw=w10, coherent gain=w11)
  Property Node(instance in=$"Window Properties Init", "eq noise bw"=w10, "coherent gain"=w11) -> (instance out=w12)
  $"Window Properties" <- w12
