vi "Find Carriers, Set Frame.gvi"   [LabVIEW Communications System Design Software 2.0.1]
inputs:
  "RX Parameters In": T1
outputs:
  "Frame Parameters Out": T3
  "Samples per Acquisition": i64
  "Test Carrier Frequencies": f64[]
panel controls:
  "Frame Parameters": T2
  "IQ frac": f64
types:
  T1 = cluster{"IQ Sampling Rate [S/sec]": f64, "Gain [dB]": f64, "Active Antenna": string, "Reference Frequency": string, "Timebase Clock Source": string, "Start Carrier [Hz]": f64, "Stop Carrier [Hz]": f64, "Acq Duration [sec]": f64}
  T2 = cluster{"IQ Rate": f64, "Frames": i32, "Length of Subset": i32, "Start Carrier [Hz]": f64, "Stop Carrier [Hz]": f64, "Acq Duration [Sec]": f64, "Start Index of Subset": i32}
  T3 = cluster{"IQ Rate": f64, "Frames": i32, "Length of Subset": i32, "Start Carrier [Hz": f64, "Stop Carrier [Hz]": f64, "Acq Duration [Sec]": f64, "Start Index of Subset": i32}
uses:
  NI::Analysis::Generation::Ramp Pattern by Increment.gvi
diagram:
  Property Node(instance in=$"RX Parameters In") -> ("IQ Sampling Rate [S/sec]"=w1, "Start Carrier [Hz]"=w2, "Stop Carrier [Hz]"=w3, "Acq Duration [sec]"=w4)
  # Acquisition Rate * IQ Sampling Rate
  Multiply(w1, w4) -> w5
  # ex1: iq frac = 0.8
  # 0.8 = 4/5
  # "A" = 1/10
  # LCM(4,5,1,10) = 20
  # w5: Acq Rate * IQ Sample Rate
  Quotient And Remainder(x=w5, y=30) -> (floor(x/y)=w6)
  # ex2: iq frac = 0.25
  # 0.25 = 1/4
  # "A" = 3/8
  # LCM(1,4,3,8) = 24
  Multiply(30, w6) -> w7
  # A note on IQ fraction:
  # During acqusition, the USRP uses baseband filters to demodulated signal.
  # Think anti-aliasing nyquist type stuff. Anyway, these filters are not ideal
  # and attenuate frequencies at the edge of half the sampling rate. Therefore,
  # when using the subspectrums it is important to throw away the edges of
  # the recorded data. IQ frac is the percentage you want to keep.
  # The default is 25%. Meaning you want to keep only the middle quarter of
  # the received sub-band.
  To Quad Integer(number=w7) -> w8
  $"Samples per Acquisition" <- w8
  # ex3: iq frac = 0.6
  # 0.6 = 3/5
  # "A" = 2/5
  # LCM(3,5,2) = 30
  Multiply(w1, $"IQ frac") -> w9
  call "Ramp Pattern by Increment.gvi"(increment=w9, end=w3, start=w2) -> (ramp pattern=w10, samples=w11)
  # multiply and divide by the LCM
  # of the num, den of IQ frac and
  # "A"
  # keep IQ frac percentage
  # of total
  Multiply($"IQ frac", w7) -> w12
  # Take the middle part
  # of the sub-band
  Subtract(x=1, y=$"IQ frac") -> w13
  # w14: "A"
  Multiply(w13, 0.5) -> w14
  Multiply(w14, w7) -> w15
  # Length of Subset and Start Index of Subset
  # should probably be a multiple of sample per
  # acquisition
  Property Node(instance in=$"Frame Parameters", "IQ Rate"=w1, "Frames"=w11, "Length of Subset"=w12, "Start Index of Subset"=w15, "Start Carrier [Hz]"=w2, "Stop Carrier [Hz]"=w3, "Acq Duration [Sec]"=w4) -> (instance out=w16)
  $"Frame Parameters Out" <- w16
  $"Test Carrier Frequencies" <- w10
