vi "Gather Signals for Saving.gvi"   [LabVIEW Communications System Design Software 2.0.1]
inputs:
  "Local Interests": "Local Interests.gtype"
  "power spectrum current": T1
  "Window Properties": T2
outputs:
  "Signal Data": "Signal Data.gtype"
  "signals2D": f64[][]
panel indicators:
  "error out": error
types:
  "Local Interests.gtype" = cluster{"Indices": u32[], "Frequencies": f64[], "Indices in sub-band?": bool}
  T1 = cluster{"f0": f64, "df": f64, "spectrum in dB": f64[]}
  T2 = cluster{"eq noise bw": f64, "coherent gain": f64}
  "Signal Data.gtype" = cluster{"fc": f64[], "df": f64, "B": u32, "Trigger Save?": bool}
uses:
  NI::Analysis::Measurement::Spectrum Unit Conversion.gvi
diagram:
  Property Node(instance in=$"power spectrum current") -> ("df"=w1, "spectrum in dB"=w2)
  call "Spectrum Unit Conversion.gvi"(spectrum in=w2, spectrum type="Power (Vrms^2)", dB type="dB", display unit="Vrms", df=w1, window constants=$"Window Properties") -> (spectrum out=w3)
  Property Node(instance in=$"Local Interests") -> ("Indices"=w4, "Frequencies"=w5, "Indices in sub-band?"=w6)
  # Note, signals2D is not the consecutive recordings.
  # There will be #numberavergages of these signals2D
  # by the end of the inner while loop.
  # signals2D:
  # 	Each row is a different signal that peaked above threshold
  # f0:
  # 	Beginning frequency of signal
  # fc:
  # 	value of max peak
  # Trigger Save?:
  # 	Boolean indicating whether to save this data
  # df:
  # 	Common df for the recorded signals
  Math Node("df"=w1, "ind"=w4, "IQ_current"=w3, "freq"=w5, "indices_in_subband"=w6) -> ("signals2D"=w7, "B"=w8, "fc"=w9, Error Out=w10)
  ~~~
  B = uint32(round(500000/df));
  L_ind = length(ind);
  L_IQ = length(IQ_current);
  signals2D = zeros(L_ind, 2*B+1);
  fc = zeros(1,L_ind);
  if indices_in_subband
      for ii = 1:L_ind
          if ind(ii) - B < 0 || ind(ii) + B > L_IQ
              %error
          else
              signals2D(ii,:) = IQ_current(ind(ii) - B : ind(ii) + B);
              fc(ii) = freq(ii);
          end
      end
  end
  ~~~
  $"error out" <- w10
  $signals2D <- w7
  Build Cluster(w9, w1, w8, w6) -> w11
  $"Signal Data" <- w11
