vi "Plot Spectrum.gvi"   [LabVIEW Communications System Design Software 2.0.1]
inputs:
  "Frame Parameters": T1
  "Spectrum to Plot In": cluster{"f0": f64, "df": f64, "IQ": f64[]}
outputs:
  "Spectrum to Plot Out": cluster{"f0": f64, "df": f64, "IQ": f64[]}
panel controls:
  "Spectrum to Plot Initialize": cluster{"f0": f64, "df": f64, "IQ": f64[]}
types:
  T1 = cluster{"IQ Rate": f64, "Frames": i32, "Length of Subset": i32, "Start Carrier [Hz": f64, "Stop Carrier [Hz]": f64, "Acq Duration [Sec]": f64, "Start Index of Subset": i32}
diagram:
  # f0 was not being calculated correctly. FIXED
  Property Node(instance in=$"Spectrum to Plot In") -> ("df"=w1, "IQ"=w2)
  Property Node(instance in=$"Frame Parameters") -> ("Start Carrier [Hz"=w3, "Length of Subset"=w4)
  Multiply(w4, 0.5) -> w5
  Multiply(w5, w1) -> w6
  Subtract(x=w3, y=w6) -> w7
  Property Node(instance in=$"Spectrum to Plot Initialize", "f0"=w7, "df"=w1, "IQ"=w2) -> (instance out=w8)
  $"Spectrum to Plot Out" <- w8
