vi "Put in Spectrum.gvi"   [LabVIEW Communications System Design Software 2.0.1]
inputs:
  "df": f64
  "data": f64[]
  "f0": f64
  "Number of Samples": f64
  "Reset": bool
  "min freq": f64
outputs:
  "Spectrum to Plot": cluster{"f0": f64, "df": f64, "IQ": f64[]}
panel controls:
  "Initialize Spectrum": cluster{"f0": f64, "df": f64, "IQ": f64[]}
diagram:
  Subtract(x=$f0, y=$"min freq") -> w1
  Quotient And Remainder(x=w1, y=$df) -> (floor(x/y)=w2)
  To Unsigned Long Integer(number=w2) -> w3
  Is First Call() -> w4
  Logical Or(w4, $Reset) -> w5
  Feedback Node(input=w6) -> w7
  case (w5) {
    frame False, Default {
      w8 = w7
    }
    frame True {
      Initialize Array(element=-130, size=$"Number of Samples") -> w9
      # Initialize Spectrum History
      Property Node(instance in=$"Initialize Spectrum", "f0"=$"min freq", "df"=$df, "IQ"=w9) -> (instance out=w8)
    }
  }
  in-place (after w8) {
    Unbundle Bundle Read Poser() -> ("IQ"=w10)
    # Add Current Spectrum to Spectrum History
    Replace Array Subset(inArray=w10, index=w3, new=$data) -> w11
    Unbundle Bundle Write Poser("IQ"=w11)
    w6 = _
  }
  $"Spectrum to Plot" <- w6
