vi "Read Data.gvi"   [LabVIEW Communications System Design Software 2.0.1]
inputs:
  "USRP Session Handle In": "niUSRPClass"
  "error in": error
  "Number of Samples": i64
outputs:
  "USRP Session Handle Out": "niUSRPClass"
  "error out": error
  "data": c128[]
diagram:
  call "niUSRP Initiate.gvi"(session handle=$"USRP Session Handle In", error in (no error)=$"error in") -> (session handle out=w1, Error Out=w2)
  call "niUSRP Fetch Rx Data (CDB).gvi"(session handle=w1, number of samples=$"Number of Samples", error in (no error)=w2) -> (session handle out=w3, data=w4, Error Out=w5)
  $"USRP Session Handle Out" <- w3
  $"error out" <- w5
  $data <- w4
