vi "Read From File ALT.gvi"   [LabVIEW Communications System Design Software 2.0.1]
inputs:
  "file path": path
  "Max Freq": f64 = 120000000
  "Min Freq": f64 = 80000000
outputs:
  "FFT Power Spectrum": cluster{"f0": f64, "df": f64, "IQ": f64[]}
  "timestamp": timestamp
panel controls:
  "Type: Waveform": waveform<f64> = {dt=0.1, Y=[]}
  "Type: Numeric Array": f64[]
  "Display History?": bool
  "Pause": bool
  "Playback Speed": f64
panel indicators:
  "iterations": i64
diagram:
  w1 = $"Type: Numeric Array"
  Strip Path(path=$"file path") -> (name=w2, stripped path=w3)
  Concatenate Strings("helper_", w2) -> w4
  Build Path(base path=w3, name or relative path=w4) -> (appended path=w5)
  TDMS Open(file path=w5, operation="open (read-only)") -> (tdms file out=w6)
  TDMS Read(data type=w1, group name in="B,df", tdms file=w6) -> (data=w7, tdms file out=w8)
  Array Index(array=w7) -> (out0[_]=w9)
  To Quad Integer(number=w9) -> w10
  Array Index(array=w7) -> (out0[1]=w11)
  # w10: B
  Multiply(w10, 2) -> w12
  Increment(x=w12) -> w13
  TDMS Open(file path=$"file path", operation="open (read-only)") -> (tdms file out=w14)
  # w11: df
  s1 = 0  # shift register
  s2 = 0  # shift register
  while {
    TDMS Read(count=20, data type=w1, group name in="tod,len,fc", offset=s2, tdms file=w8) -> (data=w15, end of file?=w16, tdms file out=w17)
    # w18: len
    Array Index(array=w15) -> (out0[1]=w18)
    To Long Integer(number=w18) -> w19
    Add(s2, w19) -> w20
    Add(2, w20) -> w21
    Multiply($"Playback Speed", 20) -> w22
    Increment(x=w22) -> w23
    Wait(time to wait=w23)
    # w24: fc
    Array Subset(array=w15, index0=2, length0=w18) -> w24
    # w25: B*df
    Multiply(w10, w11) -> w25
    # w26: f0
    Subtract(x=w24, y=w25) -> w26
    s3 = s1  # shift register
    for (N = w19) (iteration -> i1) {
      w27 = each element of w26
      Increment(x=s3) -> w28
      Multiply(s3, w13) -> w29
      TDMS Read(count=w13, data type=$"Type: Waveform", group name in="Untitled", offset=w29, return channels in file order=TRUE, tdms file=w14) -> (data=w30, tdms file out=w31)
      Property Node(instance in=w30) -> ("Y"=w32)
      Is Equal To 0(x=i1) -> w33
      Not(x=$"Display History?") -> w34
      Logical And(w34, w33) -> w35
      call "Put in Spectrum.gvi"(df=w11, data=w32, f0=w27, max freq=$"Max Freq", Reset=w35, min freq=$"Min Freq") -> (Spectrum to Plot=w36)
      next s3 = w28
    }
    $iterations <- s3
    $"FFT Power Spectrum" <- w36
    while {
      Wait(time to wait=50)
      Not(x=$Pause) -> w37
      stop if w37
    }
    # w38: tod
    Array Index(array=w15) -> (out0[0]=w38)
    To Time Stamp(number=w38) -> w39
    $timestamp <- w39
    next s1 = s3
    next s2 = w21
    stop if w16
  }
  TDMS Close(tdms file=w31)
  TDMS Close(tdms file=w17)
