vi "Read From File.gvi"   [LabVIEW Communications System Design Software 2.0.1]
inputs:
  "B": i32
panel controls:
  "file path": path
  "FFT Initialize": cluster{"f0": f64, "df": f64, "IQ": f64[]}
panel indicators:
  "loop iteration": i32
  "group/channel names": string[][]
  "property values": variant[]
  "property names": string[]
  "FFT Power Spectrum": cluster{"f0": f64, "df": f64, "IQ": f64[]}
  "Graph": waveform<f64>[]
diagram:
  TDMS Open(file path=$"file path", operation="open (read-only)") -> (tdms file out=w1)
  Multiply($B, 2) -> w2
  Increment(x=w2) -> w3
  while (iteration -> i1) {
    TDMS Get Properties(tdms file=w1) -> (property names=w4, property values=w5)
    $"property values" <- w5
    $"property names" <- w4
    TDMS List Contents(tdms file=w1) -> (group/channel names=w6)
    $"group/channel names" <- w6
    Wait(time to wait=2)
    Multiply(w3, i1) -> w7
    To Quad Integer(number=w3) -> w8
    TDMS Read(count=w8, offset=w7, return channels in file order=TRUE, tdms file=w1) -> (data=w9, end of file?=w10, tdms file out=w11)
    $Graph <- w9
    Array Size(array=w9) -> (size(s)=w12)
    for (N = w12) {
      w13 = each element of w9
      Property Node(instance in=w13) -> ("Y"=w14, "t0"=w15, "dt"=w16)
      To Double Precision Float(number=w15) -> w17
      Property Node(instance in=$"FFT Initialize", "f0"=w17, "df"=w16, "IQ"=w14) -> (instance out=w18)
    }
    $"FFT Power Spectrum" <- w18
    $"loop iteration" <- i1
    stop if w10
  }
  TDMS Close(tdms file=w11)
