vi "Save Data to File ALT.gvi"   [LabVIEW Communications System Design Software 2.0.1]
inputs:
  "TimeStamp": timestamp
  "file path": path
  "Signals3D": f64[][][]
  "Signal Data": "Signal Data.gtype"
types:
  "Signal Data.gtype" = cluster{"fc": f64[], "df": f64, "B": u32, "Trigger Save?": bool}
diagram:
  Is First Call() -> w1
  Property Node(instance in=$"Signal Data") -> ("df"=w2, "Trigger Save?"=w3, "B"=w4, "fc"=w5)
  case (w1) {
    frame False, Default {
      TDMS Open(file path=$"file path", operation="open") -> (tdms file out=w6)
      Strip Path(path=$"file path") -> (name=w8, stripped path=w9)
      Concatenate Strings("helper_", w8) -> w10
      Build Path(base path=w9, name or relative path=w10) -> (appended path=w11)
      TDMS Open(file path=w11, operation="open") -> (tdms file out=w7)
    }
    frame True {
      TDMS Open(file path=$"file path", operation="create or replace") -> (tdms file out=w6)
      Build Array(w4, w2) -> w12
      Strip Path(path=$"file path") -> (name=w13, stripped path=w14)
      Concatenate Strings("helper_", w13) -> w15
      Build Path(base path=w14, name or relative path=w15) -> (appended path=w16)
      TDMS Open(file path=w16, operation="create or replace") -> (tdms file out=w17)
      TDMS Write(data=w12, group name in="B,df", tdms file=w17) -> (tdms file out=w7)
    }
  }
  # signals3D:
  # 	The added third dimension corresponds to a time of recording,
  # 	the nth iteration of the averaging loop.
  # 	Each row is a different signal that peaked above threshold
  # f0:
  # 	Beginning frequency of signal.
  # Trigger Save?:
  # 	Boolean indicating whether to save this data
  # df:
  # 	Common df for the recorded signals
  case (w3) {
    frame False, Default {
      w18 = w6
      w19 = w7
    }
    frame True {
      for {
        w20 = each element of $Signals3D
        for {
          w21 = each element of w20
          Build Waveform Node(Y=w21, dt=w2, t0=$TimeStamp) -> (output waveform=w22)
          TDMS Write(data=w22, tdms file=w6) -> (tdms file out=w18)
        }
      }
      To Double Precision Float(number=$TimeStamp) -> w23
      Array Size(array=w5) -> (size(s)=w24)
      Build Array[ConcatenateInputs=True](w23, w24, w5) -> w25
      TDMS Write(data=w25, group name in="tod,len,fc", tdms file=w7) -> (tdms file out=w19)
    }
  }
  TDMS Close(tdms file=w18)
  TDMS Close(tdms file=w19)
