vi "Set Parameters.gvi"   [LabVIEW Communications System Design Software 2.0.1]
inputs:
  "RX Parameters In": T1
  "USRP Session Handle In": "niUSRPClass"
  "error in (no error)": error
outputs:
  "error out: HW RX Param subsetup": error
  "USRP Session Handle Out": "niUSRPClass"
  "Test Carrier Frequencies": f64[]
  "Samples per Acquisition": i64
  "Frame Parameters Out": T2
types:
  T1 = cluster{"IQ Sampling Rate [S/sec]": f64, "Gain [dB]": f64, "Active Antenna": string, "Reference Frequency": string, "Timebase Clock Source": string, "Start Carrier [Hz]": f64, "Stop Carrier [Hz]": f64, "Acq Duration [sec]": f64}
  T2 = cluster{"IQ Rate": f64, "Frames": i32, "Length of Subset": i32, "Start Carrier [Hz": f64, "Stop Carrier [Hz]": f64, "Acq Duration [Sec]": f64, "Start Index of Subset": i32}
diagram:
  # Initialize USRP properties for reading
  call "Write Rx Properties.gvi"(RX Parameters In=$"RX Parameters In", USRP Session Handle In=$"USRP Session Handle In", error in (no error)=$"error in (no error)") -> (RX Parameters Out=w1, USRP Session Handle Out=w2, error out=w3)
  # Determine frame configurations
  # and carrier frequencies
  call "Find Carriers, Set Frame.gvi"(RX Parameters In=w1) -> (Frame Parameters Out=w4, Samples per Acquisition=w5, Test Carrier Frequencies=w6)
  $"Frame Parameters Out" <- w4
  $"Samples per Acquisition" <- w5
  $"Test Carrier Frequencies" <- w6
  $"USRP Session Handle Out" <- w2
  $"error out: HW RX Param subsetup" <- w3
