vi "Signal Power Detection.gvi"   [LabVIEW Communications System Design Software 2.0.1]
inputs:
  "Power Spectrum": cluster{"f0": f64, "df": f64, "IQ": f64[]}
  "threshold": f64
outputs:
  "Freqs above threshold": f64[]
  "indices": i32[]
  "count": i32
uses:
  NI::Analysis::Measurement::Threshold Detector.gvi
diagram:
  Property Node(instance in=$"Power Spectrum") -> ("f0"=w1, "df"=w2, "IQ"=w3)
  # w2: note, df = sample rate / samples
  call "Threshold Detector.gvi"(signal=w3, threshold=$threshold, width=1) -> (indices=w4, count=w5)
  Multiply(w2, w4) -> w6
  Add(w1, w6) -> w7
  $"Freqs above threshold" <- w7
  $indices <- w4
  $count <- w5
