vi "Spectrum History.gvi"   [LabVIEW Communications System Design Software 2.0.1]
inputs:
  "Waterfall Time Scale (s)": i32 = 5
  "Magnitude": f64[]
outputs:
  "Waterfall Plot": f64[][]
diagram:
  Array Size(array=$Magnitude) -> (size(s)=w1)
  # w1: Number of Samples
  Is First Call() -> w2
  case (w2) {
    frame False, Default {
      w3 = default
    }
    frame True {
      Initialize Array(element=-120, size=w1, size=$"Waterfall Time Scale (s)") -> w3
    }
  }
  Feedback Node(initial value=w3, input=w4) -> w5
  Insert Into Array(inArray=w5, index1=0, new=$Magnitude) -> w6
  Delete From Array(inArray=w6, length (1)=w1, index1=$"Waterfall Time Scale (s)") -> w4
  $"Waterfall Plot" <- w4
