vi "Spectrum Monitor (no saving).gvi"   [LabVIEW Communications System Design Software 2.0.1]
outputs:
  "LO Frequency": f64
  "Spectrum Size": i32
  "Frame Parameters Out": T5
panel controls:
  "RX Parameters In": T1 = {"IQ Sampling Rate [S/sec]"=20000000, "Gain [dB]"=0, "Reference Frequency"="Internal", "Timebase Clock Source"="Internal", "Start Carrier [Hz]"=75000000, "Stop Carrier [Hz]"=125000000, "Acq Duration [sec]"=0.0001, "Active Antenna"="RX2"}
  "Device Names": "niUSRPClass" = "192.168.10.2"
  "Averaging Parameters": "Averaging Parameters.gtype" = {"averaging mode"="RMS averaging", "weighting mode"="Linear", "number of averages"=4}  # averaging parameters defines how the averaging is computed. The specifications of the parameters include the type of averaging, the type of weighting, and the number of averages.
  "Display": T4 = {"display unit"="Vrms", "dB type"="dB"}
  "Stop Capture": bool
  "Tab": i32
  "threshold": f64 = -60
  "IQ frac": enum{"0.25", "0.5", "0.6", "0.8"} = "0.25"
  "Waterfall History Length": i32 = 1
  "Compress Frequency Bins?": bool
panel indicators:
  "error out": error
  "Samples per Acquisition": i64
  "Carrier Freq Out": f64
  "FFT Power Spectrum": cluster{"f0": f64, "df": f64, "IQ": f64[]}
  "Carrier List": f64[]
  "Power Detection": "Power Detection cluster.gtype"
  "Waterfall Plot": f64[][]
  "period (ms)": u32
types:
  T1 = cluster{"IQ Sampling Rate [S/sec]": f64, "Gain [dB]": f64, "Reference Frequency": string, "Timebase Clock Source": string, "Start Carrier [Hz]": f64, "Stop Carrier [Hz]": f64, "Acq Duration [sec]": f64, "Active Antenna": string}
  T2 = enum{"No averaging", "Vector averaging", "RMS averaging", "Peak hold"}
  "Averaging Parameters.gtype" = cluster{"averaging mode": T2, "weighting mode": enum{"Linear", "Exponential"}, "number of averages": u32}
  T3 = enum{"Vrms", "Vpk", "Vrms^2", "Vpk^2", "Vrms/rtHz", "Vpk/rtHz", "Vrms^2/Hz", "Vpk^2/Hz"}
  T4 = cluster{"display unit": T3, "dB type": enum{"Linear", "dB", "dBm"}}
  T5 = cluster{"IQ Rate": f64, "Frames": i32, "Length of Subset": i32, "Start Carrier [Hz": f64, "Stop Carrier [Hz]": f64, "Acq Duration [Sec]": f64, "Start Index of Subset": i32}
  "Power Detection cluster.gtype" = cluster{"Estimated Freqs. above Threshold": f64[], "Power at those Freqs.": f64[], "Num. peaks detected": i32, "Num. in queue": i32}
diagram:
  call "niUSRP Open Rx Session.gvi"(niUSRP Device=$"Device Names") -> (error out=w1, session handle out=w2)
  call "Set Parameters.gvi"(RX Parameters In=$"RX Parameters In", USRP Session Handle In=w2, error in (no error)=w1, IQ frac=$"IQ frac") -> (error out: HW RX Param subsetup=w3, USRP Session Handle Out=w4, Test Carrier Frequencies=w5, Samples per Acquisition=w6, Frame Parameters Out=w7, IQ frac out=w8)
  call "niUSRP Configure Number of Samples.gvi"(session handle=w4, number of samples is finite=TRUE, number of samples=w6, error in (no error)=w3) -> (session handle out=w9, Error Out=w10)
  w11 = $"Waterfall History Length"
  w12 = $"Compress Frequency Bins?"
  Tick Count() -> (timer value=w13)
  # Testing Spectrum Monitor. Not as many indicators will
  # be on panel in final version.
  while {
    w14 = $"Averaging Parameters"
    w15 = $Display
    # Go back to the first carrier frequency and repeat
    s1 = 0  # shift register
    for (iteration -> i1) (after w8) {
      w16 = each element of w5
      call "Set Carrier and LO_2.gvi"(Current Frequency=w16, niusrp in_2=w9, error in=w10) -> (Error=w17, Usrp.niUSRPClass=w18)
      # Get new carrier frequency
      Property Node(instance in=w14) -> ("number of averages"=w19, instance out=w20)
      To Long Integer(number=w19) -> w21
      for (N = w21) (iteration -> i2) {
        # Averaging Loop
        call "Read Data.gvi"(USRP Session Handle In=w18, error in=w17, Number of Samples=w6) -> (USRP Session Handle Out=w23, error out=w24, data=w25)
        Is Equal To 0(x=i2) -> w26
        call "Establish Sub-band.gvi"(Restart Averaging=w26, Frame Parameters=w7, Averaging Parameters=w20, error in=w24, Input Baseband IQ=w25) -> (Power Spectrum averaged Subset=w27, Window Properties=w28, error out=w29, Frame Parameters Out=w30)
        # w26: First Rx for this carrier?
        Logical Or(w29, $"Stop Capture") -> w31
        append w29 to w22
        stop if w31
      }
      Merge Errors(w22) -> (error out=w32)
      Property Node(instance in=w23, error in=w32) -> ("Carrier Frequency"=w33, "LO Frequency"=w34, error out=w35, instance out=w36)
      $"Carrier Freq Out" <- w33
      $"LO Frequency" <- w34
      call "Aggregate Sub-band into Spectrum.gvi"(Frame Parameters=w30, Power Spectrum Subset=w27, Window Properties In=w28, Display=w15, Iteration=i1) -> (Spectrum to Plot=w37, Frame Parameters Out=w38, Spectrum Size=w39)
      call "Plot Spectrum.gvi"(Frame Parameters=w38, Spectrum to Plot In=w37) -> (Spectrum to Plot Out=w40, Frame Parameters out=w41)
      $"FFT Power Spectrum" <- w40
      $"Spectrum Size" <- w39
      next s1 = w34
      stop if w31
    }
    call "Signal Power Detection_2.gvi"(Power Spectrum=w40, threshold=$threshold, Frame Parameters Out=w41) -> (Power at those Freqs.=w42, Est. Freqs above Thresh=w43, count=w44, sub_band_ind=w45)
    call "Array Fill.gvi"(sub_band_ind=w45, Est. Freqs above Thresh=w43, Count=w44) -> (number elements in array=w46)
    Build Cluster(w43, w42, w44, w46) -> w47
    $"Power Detection" <- w47
    call "Waterfal Plot Generator.gvi"(Compress?=w12, FFT Power Spectrum=w40, Waterfall History Length=w11) -> (Waterfall Plot=w48)
    $"Waterfall Plot" <- w48
    Tick Count() -> (timer value=w49)
    Feedback Node(initial value=w13, input=w49) -> w50
    Subtract(x=w49, y=w50) -> w51
    $"period (ms)" <- w51
    stop if w31
  }
  call "niUSRP Abort.gvi"(Handle in=w36, error in (no error)=w35) -> (Handle out=w52, Error Out=w53)
  call "niUSRP Close Session.gvi"(handle in=w52, error in=w53) -> (error out=w54)
  $"error out" <- w54
  $"Carrier List" <- w5
  $"Samples per Acquisition" <- w6
  $"Frame Parameters Out" <- w7
