vi "Spectrum Monitor.gvi"   [LabVIEW Communications System Design Software 2.0.1]
panel controls:
  "RX Parameters In": T1 = {"IQ Sampling Rate [S/sec]"=20000000, "Gain [dB]"=0, "Reference Frequency"="Internal", "Timebase Clock Source"="Internal", "Start Carrier [Hz]"=95000000, "Stop Carrier [Hz]"=105000000, "Acq Duration [sec]"=0.0001, "Active Antenna"="RX2"}
  "Device Names": "niUSRPClass" = "192.168.10.2"
  "Averaging Parameters": "Averaging Parameters.gtype" = {"averaging mode"="RMS averaging", "weighting mode"="Linear", "number of averages"=4}  # averaging parameters defines how the averaging is computed. The specifications of the parameters include the type of averaging, the type of weighting, and the number of averages.
  "Display": T4 = {"display unit"="Vrms", "dB type"="dB"}
  "Stop Capture": bool
  "Tab": i32
  "threshold": f64 = -40
  "IQ frac": enum{"0.25", "0.5", "0.6", "0.8"} = "0.25"
  "file path": path
  "Waterall History Length": i32 = 1
  "Compress Frequency Bins?": bool
panel indicators:
  "error out": error
  "Samples per Acquisition": i64
  "Carrier Freq Out": f64
  "FFT Power Spectrum": cluster{"f0": f64, "df": f64, "IQ": f64[]}
  "LO Frequency": f64
  "Carrier List": f64[]
  "Power Detection": "Power Detection cluster.gtype"
  "2D(freq,ind)": f64[][]
  "signals3D": f64[][][]
  "Waterfall Plot": f64[][]
  "period (ms)": u32
  "Spectrum Size": i32
  "Frame Parameters Out": T5
  "Signal Data": "Signal Data.gtype"
types:
  T1 = cluster{"IQ Sampling Rate [S/sec]": f64, "Gain [dB]": f64, "Reference Frequency": string, "Timebase Clock Source": string, "Start Carrier [Hz]": f64, "Stop Carrier [Hz]": f64, "Acq Duration [sec]": f64, "Active Antenna": string}
  T2 = enum{"No averaging", "Vector averaging", "RMS averaging", "Peak hold"}
  "Averaging Parameters.gtype" = cluster{"averaging mode": T2, "weighting mode": enum{"Linear", "Exponential"}, "number of averages": u32}
  T3 = enum{"Vrms", "Vpk", "Vrms^2", "Vpk^2", "Vrms/rtHz", "Vpk/rtHz", "Vrms^2/Hz", "Vpk^2/Hz"}
  T4 = cluster{"display unit": T3, "dB type": enum{"Linear", "dB", "dBm"}}
  T5 = cluster{"IQ Rate": f64, "Frames": i32, "Length of Subset": i32, "Start Carrier [Hz": f64, "Stop Carrier [Hz]": f64, "Acq Duration [Sec]": f64, "Start Index of Subset": i32}
  "Power Detection cluster.gtype" = cluster{"Estimated Freqs. above Threshold": f64[], "Power at those Freqs.": f64[], "Num. peaks detected": i32, "Num. in queue": i32}
  "Signal Data.gtype" = cluster{"fc": f64[], "df": f64, "B": u32, "Trigger Save?": bool}
diagram:
  call "niUSRP Open Rx Session.gvi"(niUSRP Device=$"Device Names") -> (error out=w1, session handle out=w2)
  call "Set Parameters.gvi"(RX Parameters In=$"RX Parameters In", USRP Session Handle In=w2, error in (no error)=w1, IQ frac=$"IQ frac") -> (error out: HW RX Param subsetup=w3, USRP Session Handle Out=w4, Test Carrier Frequencies=w5, Samples per Acquisition=w6, Frame Parameters Out=w7, IQ frac out=w8)
  call "niUSRP Configure Number of Samples.gvi"(session handle=w4, number of samples is finite=TRUE, number of samples=w6, error in (no error)=w3) -> (session handle out=w9, Error Out=w10)
  w11 = $"file path"
  w12 = $"Waterall History Length"
  Tick Count() -> (timer value=w13)
  # Testing Spectrum Monitor. Not as many indicators will
  # be on panel in final version.
  s1 = uninitialised  # shift register
  while {
    w14 = $"Averaging Parameters"
    Is First Call() -> w15
    w16 = $Display
    w17 = $Display
    # Go back to the first carrier frequency and repeat
    s2 = 0  # shift register
    for (iteration -> i1) {
      w18 = each element of w5
      # Get new carrier frequency
      Property Node(instance in=w14) -> ("number of averages"=w19, instance out=w20)
      call "Set Carrier and LO_2.gvi"(Current Frequency=w18, niusrp in_2=w9, error in=w10) -> (Error=w21, Usrp.niUSRPClass=w22)
      call "Array Indices for Sub-band.gvi"(First call=w15, error in=w21, 2D(freq,ind)=s1, niusrp in=w22, IQ frac=w8) -> (Local Interests=w23, error out=w24, Usrp.niUSRPClass out=w25)
      To Long Integer(number=w19) -> w26
      for (N = w26) (iteration -> i2) {
        Get Current Time() -> (current time=w29)
        # Averaging Loop
        call "Read Data.gvi"(USRP Session Handle In=w25, error in=w24, Number of Samples=w6) -> (USRP Session Handle Out=w30, error out=w31, data=w32)
        Is Equal To 0(x=i2) -> w33
        call "Establish Sub-band.gvi"(Restart Averaging=w33, Frame Parameters=w7, Averaging Parameters=w20, error in=w31, Input Baseband IQ=w32) -> (Power Spectrum averaged Subset=w34, Window Properties=w35, error out=w36, Frame Parameters Out=w37, power spectrum current=w38)
        call "Gather Signals for Saving.gvi"(Local Interests=w23, power spectrum current=w38, Window Properties=w35, Display=w16) -> (Signal Data=w39, signals2D=w40)
        # w33: First Rx for this carrier?
        Logical Or(w36, $"Stop Capture") -> w41
        append w36 to w27
        append w40 to w28
        stop if w41
      }
      $signals3D <- w28
      call "Save Data to File ALT.gvi"(TimeStamp=w29, file path=w11, Signals3D=w28, Signal Data=w39)
      Merge Errors(w27) -> (error out=w42)
      Property Node(instance in=w30, error in=w42) -> ("Carrier Frequency"=w43, "LO Frequency"=w44, error out=w45, instance out=w46)
      $"Carrier Freq Out" <- w43
      $"Signal Data" <- w39
      $"LO Frequency" <- w44
      call "Aggregate Sub-band into Spectrum.gvi"(Frame Parameters=w37, Power Spectrum Subset=w34, Window Properties In=w35, Display=w17, Iteration=i1) -> (Spectrum to Plot=w47, Frame Parameters Out=w48, Spectrum Size=w49)
      call "Plot Spectrum.gvi"(Frame Parameters=w48, Spectrum to Plot In=w47) -> (Spectrum to Plot Out=w50, Frame Parameters out=w51)
      $"FFT Power Spectrum" <- w50
      $"Spectrum Size" <- w49
      next s2 = w44
      stop if w41
    }
    call "Signal Power Detection_2.gvi"(Power Spectrum=w50, threshold=$threshold, Frame Parameters Out=w51) -> (Power at those Freqs.=w52, Est. Freqs above Thresh=w53, count=w54, sub_band_ind=w55)
    call "Array Fill.gvi"(sub_band_ind=w55, Est. Freqs above Thresh=w53, Count=w54) -> (2D(freq,ind)=w56, number elements in array=w57)
    $"2D(freq,ind)" <- w56
    Build Cluster(w53, w52, w54, w57) -> w58
    $"Power Detection" <- w58
    call "Waterfal Plot Generator.gvi"(Compress?=$"Compress Frequency Bins?", FFT Power Spectrum=w50, Waterfall History Length=w12) -> (Waterfall Plot=w59)
    $"Waterfall Plot" <- w59
    Tick Count() -> (timer value=w60)
    Feedback Node(initial value=w13, input=w60) -> w61
    Subtract(x=w60, y=w61) -> w62
    $"period (ms)" <- w62
    next s1 = w56
    stop if w41
  }
  call "niUSRP Abort.gvi"(Handle in=w46, error in (no error)=w45) -> (Handle out=w63, Error Out=w64)
  call "niUSRP Close Session.gvi"(handle in=w63, error in=w64) -> (error out=w65)
  $"error out" <- w65
  $"Carrier List" <- w5
  $"Samples per Acquisition" <- w6
  $"Frame Parameters Out" <- w7
