vi "Write Rx Properties.gvi"   [LabVIEW Communications System Design Software 2.0.1]
inputs:
  "RX Parameters In": T1
  "USRP Session Handle In": "niUSRPClass"
  "error in (no error)": error
outputs:
  "RX Parameters Out": T1
  "USRP Session Handle Out": "niUSRPClass"
  "error out": error
panel indicators:
  "Reference Frequency Source_2": string
  "Timebase Clock Source_2": string
types:
  T1 = cluster{"IQ Sampling Rate [S/sec]": f64, "Gain [dB]": f64, "Reference Frequency": string, "Timebase Clock Source": string, "Start Carrier [Hz]": f64, "Stop Carrier [Hz]": f64, "Acq Duration [sec]": f64, "Active Antenna": string}
diagram:
  Property Node(instance in=$"RX Parameters In") -> ("IQ Sampling Rate [S/sec]"=w1, "Gain [dB]"=w2, "Active Antenna"=w3, "Reference Frequency"=w4, "Timebase Clock Source"=w5, "Start Carrier [Hz]"=w6, instance out=w7)
  Property Node(instance in=$"USRP Session Handle In", sub-item="0", "IQ Rate"=w1, "Gain"=w2, "Active Antenna"=w3, "Reference Frequency Source"=w4, "Timebase Clock Source"=w5, "Carrier Frequency"=w6, error in=$"error in (no error)") -> ("IQ Rate"=w8, "Gain"=w9, "Carrier Frequency"=w10, error out=w11, instance out=w12)
  call "niUSRP Commit.gvi"(session handle=w12, error in (no error)=w11) -> (session handle out=w13, Error Out=w14)
  $"USRP Session Handle Out" <- w13
  $"error out" <- w14
  Property Node(instance in=w7, "IQ Sampling Rate [S/sec]"=w8, "Gain [dB]"=w9, "Start Carrier [Hz]"=w10) -> (instance out=w15)
  $"RX Parameters Out" <- w15
