vi "USRP Aggregate Spectrum.gvi"   [LabVIEW Communications System Design Software 2.0.1]
inputs:
  "Frame Parameters": T1
  "error in": error
  "Input Baseband IQ": c128[]
  "Window Parameters": T2 = {"window type"=0, "window parameter"=NaN}
  "Reset": bool
  "Iteration": i32
  "Averaging Parameters": "Averaging Parameters.gtype" = {"averaging mode"="No averaging", "weighting mode"="Exponential", "number of averages"=10}  # averaging parameters defines how the averaging is computed. The specifications of the parameters include the type of averaging, the type of weighting, and the number of averages.
  "Restart Averaging": bool
outputs:
  "Window Properties": T3
  "error out": error
  "Spectrum to Plot": cluster{"f0": f64, "df": f64, "IQ": f64[]}
  "Frame Parameters Out": T1
panel controls:
  "Window Properties Init": T3
  "Initialize Spectrum": cluster{"f0": f64, "df": f64, "IQ": f64[]}
panel indicators:
  "IQ array size": i32
  "Full size": i32
  "edges removed": i32
types:
  T1 = cluster{"IQ Rate": f64, "Frames": i32, "Length of Subset": i32, "Start Carrier [Hz": f64, "Stop Carrier [Hz]": f64, "Acq Duration [Sec]": f64, "Start Index of Subset": i32}
  "windowTd.gtype" = u32
  T2 = cluster{"window type": "windowTd.gtype", "window parameter": f64}
  T3 = cluster{"eq noise bw": f64, "coherent gain": f64}
  T4 = enum{"No averaging", "Vector averaging", "RMS averaging", "Peak hold"}
  "Averaging Parameters.gtype" = cluster{"averaging mode": T4, "weighting mode": enum{"Linear", "Exponential"}, "number of averages": u32}
uses:
  NI::Analysis::Measurement::Power Spectrum for 1 Chan (CDB).gvi
  NI::Analysis::Windows::Window Properties by Name.gvi
diagram:
  s1 = uninitialised  # shift register
  while {
    Property Node(instance in=$"Frame Parameters") -> ("IQ Rate"=w1, "Frames"=w2, "Length of Subset"=w3, "Start Index of Subset"=w4, instance out=w5)
    # w3: Length of Subset
    $"Frame Parameters Out" <- w5
    Multiply(w2, w3) -> w6
    # Reset is unused
    Is First Call() -> w7
    Logical Or(w7, $Reset) -> w8
    Reciprocal(x=w1) -> w9
    Build Waveform Node(Y=$"Input Baseband IQ", dt=w9) -> (output waveform=w10)
    call "Power Spectrum for 1 Chan (CDB).gvi"(signal=w10, averaging parameters=$"Averaging Parameters", error in=$"error in", restart averaging=$"Restart Averaging") -> (power spectrum=w11, error out=w12)
    # w4: Start Index
    Property Node(instance in=w11) -> ("df"=w13, "magnitude"=w14)
    case (w8) {
      frame False, Default {
        w15 = s1
      }
      frame True {
        Initialize Array(element=0, size=w6) -> w16
        # Initialize Spectrum History
        Property Node(instance in=$"Initialize Spectrum", "df"=w13, "IQ"=w16) -> (instance out=w15)
      }
    }
    # Remove Edges of Current Spectrum
    Array Subset(array=w14, index0=w4, length0=w3) -> w17
    Multiply($Iteration, w3) -> w18
    in-place (after w15) {
      Unbundle Bundle Read Poser() -> ("IQ"=w20)
      # Add Current Spectrum to Spectrum History
      Replace Array Subset(inArray=w20, index=w18, new=w17) -> w21
      Unbundle Bundle Write Poser("IQ"=w21)
      w19 = _
    }
    Property Node(instance in=w19) -> ("IQ"=w22)
    Array Size(array=w22) -> (size(s)=w23)
    $"IQ array size" <- w23
    $"error out" <- w12
    Array Size(array=w14) -> (size(s)=w24)
    $"Full size" <- w24
    Array Size(array=w17) -> (size(s)=w25)
    $"edges removed" <- w25
    Property Node(instance in=$"Window Parameters") -> ("window type"=w26, "window parameter"=w27)
    Array Size(array=$"Input Baseband IQ") -> (size(s)=w28)
    call "Window Properties by Name.gvi"(size=w28, window type=w26, window parameter=w27) -> (eq noise bw=w29, coherent gain=w30)
    Property Node(instance in=$"Window Properties Init", "eq noise bw"=w29, "coherent gain"=w30) -> (instance out=w31)
    $"Window Properties" <- w31
    next s1 = w19
    stop if TRUE
  }
  $"Spectrum to Plot" <- s1
