vi "USRP_NI_IQ.gvi"   [LabVIEW Communications System Design Software 2.0.1]
inputs:
  "IVI Refnum In": "niUSRPClass"
  "error in": error
  "Number of Samples": i64
  "Carrier Frequency": f64
  "Active Antenna": string
outputs:
  "IVI Refnum Out": "niUSRPClass"
  "error out": error
  "data": c128[]
  "Carrier Freq Out": f64
diagram:
  call "Clear Error Cluster.gvi"(error in=$"error in") -> (error out=w1)
  case (w1) {
    frame No Error, Default {
      Property Node(instance in=$"IVI Refnum In", "Number of Samples Is Finite"=TRUE, "Number of Samples"=$"Number of Samples", "Carrier Frequency"=$"Carrier Frequency", "Active Antenna"=$"Active Antenna", error in=w1) -> (error out=w6, instance out=w7)
      call "niUSRP Commit.gvi"(session handle=w7, error in=w6) -> (session handle out=w8, error out=w9)
      call "niUSRP Initiate.gvi"(session handle=w8, error in=w9) -> (session handle out=w10, error out=w11)
      call "niUSRP Fetch Rx Data (CDB).gvi"(session handle=w10, number of samples=$"Number of Samples", error in=w11) -> (session handle out=w12, data=w3, error out=w13)
      call "niUSRP Abort.gvi"(session handle=w12, error in=w13) -> (session handle out=w4, error out=w2)
      w5 = $"Carrier Frequency"
    }
    frame Error {
      w2 = w1
      w3 = c128[] []
      w4 = $"IVI Refnum In"
      w5 = $"Carrier Frequency"
    }
  }
  $"IVI Refnum Out" <- w4
  $"error out" <- w2
  $data <- w3
  $"Carrier Freq Out" <- w5
