vi "Waterfall Plotter.gvi"   [LabVIEW Communications System Design Software 2.0.1]
panel controls:
  "FFT Power Spectrum": cluster{"f0": f64, "df": f64, "IQ": f64[]}
  "timestamp": T1
  "Initialize Waterfall": cluster{"f0": f64, "df": f64, "IQ": f64[]}
types:
  T1 = cluster{"whole seconds": u64, "fractional seconds": f64}
diagram:
  case (FALSE) {
    frame False, Default { }
    frame True {
      Build Cluster Array($"Initialize Waterfall")
    }
  }
  Build Cluster Array($"FFT Power Spectrum")
  Property Node(instance in=$timestamp)
